# Dynamo graph 01_Insert_Shared_Parameters.dyn "Rotina 01 – Inserir Parâmetros Compartilhados_v02" (Dynamo 3.6.1.9895)

# group: Criação dos parâmetros compartilhados
file_path = Filename("E:\ARTIGO IFC\BIM+DYNAMO\rotina finalizada\Parametros\Parametros_compartilhados.txt")  # graph input
python_script = Python(IN[0]=file_path)  # CPython3; graph output
# ---------- python_script.python (20 lines) ----------
import clr
clr.AddReference("RevitServices")
from RevitServices.Persistence import DocumentManager

clr.AddReference("RevitAPI")
from Autodesk.Revit.DB import *

# Documento e aplicação
doc = DocumentManager.Instance.CurrentDBDocument
uiapp = DocumentManager.Instance.CurrentUIApplication
app = uiapp.Application

# Caminho do arquivo TXT de parâmetros compartilhados (input do Dynamo)
shared_params_file = IN[0]

# Configura o Revit para usar este arquivo
app.SharedParametersFilename = shared_params_file

# Feedback para o usuário
OUT = "✅ Arquivo de parâmetros compartilhados registrado no Revit:\n{}".format(shared_params_file)
# ----------------------------------------
