# Dynamo graph 02_Import_Information_Requirements.dyn "Rotina 02 - Importação dos Requisitos de Informação_v05" (Dynamo 3.6.1.9895)

# group: Retorna os parâmetros compartilhados
# Salvos dentro do Revit via bloco de notas.
code_block = CodeBlock { refresh: bool = true; }
python_script = Python(IN[0]=code_block)  # CPython3
# ---------- python_script.python (28 lines) ----------
# Texto padrão
import clr

clr.AddReference("RevitServices")
import RevitServices
from RevitServices.Persistence import DocumentManager

# Documento/aplicativo/interface atual
uiapp = DocumentManager.Instance.CurrentUIApplication 
app = uiapp.Application 

# Inicialização de listas para armazenar apenas os parâmetros
paramDefs, paramNames = [], []

# Abrindo o arquivo de parâmetros compartilhados
file = app.OpenSharedParameterFile()

# Obtendo os grupos de parâmetros
groups = file.Groups

# Iterando sobre os grupos e suas definições
for group in groups:
    for d in group.Definitions:
        paramDefs.append(d)  # Adicionando definição do parâmetro à lista
        paramNames.append(d.Name)  # Adicionando nome do parâmetro à lista

# Preparando a saída para o Dynamo
OUT = paramDefs, paramNames
# ----------------------------------------
code_block_2 = CodeBlock(out=python_script) { out[0]; out[1]; }

# group: Importa os atributos e o grup de parâmetros incorporados (padrão RevitAPI)
# BuiltInParameterGroup Enumeration para versões do Revit anteriores a 2025 e GroupTypeId para versões a partir de 2025.
localização_do_arquivo_com = Filename("..\json\atributos.json")  # "Localização do Arquivo com Parâmetros"; graph input
readText = FileSystem.ReadText(file=localização_do_arquivo_com)
parseJSON = Data.ParseJSON(json=readText)
python_script_2 = Python(IN[0]=parseJSON)  # CPython3
# ---------- python_script_2.python (39 lines) ----------
import clr

# Revit Services
clr.AddReference("RevitServices")
import RevitServices
from RevitServices.Persistence import DocumentManager

# Obter versão do Revit
uiapp = DocumentManager.Instance.CurrentUIApplication
app = uiapp.Application
rvt_year = int(app.VersionNumber)

# Importação condicional das classes conforme versão
clr.AddReference("RevitAPI")
if rvt_year > 2024:
    from Autodesk.Revit.DB import GroupTypeId as GroupTypeClass
else:
    from Autodesk.Revit.DB import BuiltInParameterGroup as GroupTypeClass

# Entrada do JSON
data = IN[0]

# Saídas
name = []
parameter_group = []
instance = []

# Processa os dados
for item in data:
    name.append(item.get("SharedParameterName"))
    instance.append(item.get("Instance"))

    if rvt_year > 2024:
        parameter_group.append(GroupTypeClass.Ifc)
    else:
        parameter_group.append(GroupTypeClass.PG_IFC)

# Saída para o Dynamo
OUT = name, parameter_group, instance
# ----------------------------------------
code_block_3 = CodeBlock(out=python_script_2) { out[0]; out[1]; out[2]; }
indexOf = List.IndexOf(list=code_block_2.out1, element=code_block_3.out0)

# group (continued): Retorna os parâmetros compartilhados
code_block_4 = CodeBlock(pdef=code_block_2.out0, i=indexOf) { pdef[i]; }

# group: Adiciona os parâmetros compartilhados no projeto
# O parâmetros devem ser preenchidos caso seja adiconado um novo elemento. A rotina automatiza também este processo.
lista_dos_ids_de_categorias_a = CodeBlock()  # "Lista dos IDs de Categorias a Receber os Parâmetros"
# ---------- lista_dos_ids_de_categorias_a.designscript (14 lines) ----------
[
  -2000996, -2008016, -2009060, -2001012, -2001370, -2006138, -2009009,
  -2009003, -2008130, -2006133, -2000100, -2001000, -2008132, -2008126,
  -2008010, -2008049, -2008128, -2009030, -2008212, -2001055, -2008081,
  -2008232, -2008087, -2008079, -2001060, -2008000, -2008020, -2006130,
  -2008228, -2001354, -2001040, -2001350, -2008234, -2001140, -2001046,
  -2000120, -2001180, -2001220, -2008231, -2006241, -2001039, -2008039,
  -2000038, -2001300, -2006261, -2000126, -2008122, -2008123, -2000014,
  -2006271, -2001058, -2008160, -2008161, -2003400, -2000080, -2000151,
  -2000267, -2000171, -2000170, -2001036, -2000011, -2000269, -2001160,
  -2006131, -2001330, -2000032, -2000023, -2001320, -2000180, -2008124,
  -2000340, -2008193, -2001100, -2001079, -2006135, -2000035, -2006274,
  -2008013, -2008203, -2008044, -2008050, -2008208, -2001360, -2009000
];
# ----------------------------------------
modo_de_execução = CustomSelection("Criar parâmetros", items={Criar parâmetros: "true", Preencher parâmetros: "false"}, IsVisibleDropDownTextBlock=true)  # graph input
python_script_3 = Python(IN[0]=code_block_4, IN[1]=code_block_3.out1, IN[2]=code_block_3.out2, IN[3]=lista_dos_ids_de_categorias_a, IN[4]=modo_de_execução)  # CPython3
# ---------- python_script_3.python (95 lines) ----------
import clr

# Referências Revit
clr.AddReference("RevitServices")
from RevitServices.Persistence import DocumentManager
from RevitServices.Transactions import TransactionManager

clr.AddReference("RevitAPI")
from Autodesk.Revit.DB import *

# Documento ativo
doc = DocumentManager.Instance.CurrentDBDocument

# Entradas do Dynamo
param_defs = IN[0]           # Lista de ExternalDefinition
parameter_groups = IN[1]     # Lista de BuiltInParameterGroup ou GroupTypeId
instance_flags = IN[2]       # Lista de True/False para instância/tipo
categorias_ids = IN[3]       # Lista de IDs das categorias
create_params = IN[4]        # Valor booleano vindo do Custom Selection: True ou False

# Função para obter nomes de parâmetros já existentes
def get_existing_param_names():
    bindings = doc.ParameterBindings
    it = bindings.ForwardIterator()
    it.Reset()
    names = []
    while it.MoveNext():
        definition = it.Key
        names.append(definition.Name)
    return names

existing_names = get_existing_param_names()

# Inicializa listas de resultado
added_params = []
results = []
messages = []

# Inicia transação
TransactionManager.Instance.EnsureInTransaction(doc)

for defn, group, is_inst in zip(param_defs, parameter_groups, instance_flags):
    try:
        name = defn.Name

        # Criar parâmetro se solicitado
        if create_params:
            if name in existing_names:
                messages.append(f"'{name}' já existe no projeto.")
                results.append(False)
                added_params.append(None)
            else:
                # Define categorias usando IDs
                catSet = CategorySet()
                for cid in categorias_ids:
                    cat = doc.Settings.Categories.get_Item(cid)
                    if cat and cat.AllowsBoundParameters:
                        catSet.Insert(cat)

                # Cria binding (instância ou tipo)
                binding = InstanceBinding(catSet) if is_inst else TypeBinding(catSet)

                # Insere o parâmetro no projeto
                success = doc.ParameterBindings.Insert(defn, binding, group)
                if success:
                    messages.append(f"'{name}' adicionado com sucesso.")
                    results.append(True)
                    added_params.append(defn)
                else:
                    messages.append(f"Falha ao adicionar '{name}'.")
                    results.append(False)
                    added_params.append(None)
        else:
            # Apenas preenchimento
            added_params.append(None)
            results.append(True)

        # Preencher "N/A" nos elementos existentes
        param_elem_value = "N/A"
        collector = FilteredElementCollector(doc).WhereElementIsNotElementType().ToElements()
        for elem in collector:
            param = elem.LookupParameter(name)
            if param and param.StorageType == StorageType.String:
                if not param.AsString():
                    param.Set(param_elem_value)

    except Exception as e:
        messages.append(f"Erro com '{defn.Name}': {str(e)}")
        results.append(False)
        added_params.append(None)

TransactionManager.Instance.TransactionTaskDone()

# Saída
OUT = added_params, results, messages
# ----------------------------------------
